# Grasshopper definition structural_analysis.gh (Grasshopper 1.0.7)
# plug-ins: OpenSeesUtility

# ---- group: Select Frame Model Type
list = ValueList({"Line Frame(Load on sub edge)": 0, "Line Frame(Load on main and sub edge)": 1, "Segmented Line Frame(Load on main and sub edge)": 2, "Segmented Polyline Frame(Load on main and sub edge)": 3}, selected="Segmented Polyline Frame(Load on main and sub edge)")

# ----
python = GhPythonScript(next_flag=Toggle(True))  # -> main_edge_layer, sub_edge_layer, divided_main_edge_layer, split_master_main_edge_layer, split_master_sub_edge_layer, bolt_layer, split_main_edge_layer, split_sub_edge_layer
# ---------- python: Python ----------
import scriptcontext as sc
import Rhino as rh
import rhinoscriptsyntax as rs

# Set the directory of document
# https://qiita.com/jhorikawa_err/items/827a83033083507bed91
sc.doc = rh.RhinoDoc.ActiveDoc 

# Nomal Frame Model
main_edge_layer = []
sub_edge_layer = []
divided_main_edge_layer = []

split_master_main_edge_layer = []
split_master_sub_edge_layer = []

# Split Frame Model
split_main_edge_layer = []
split_sub_edge_layer = []

bolt_layer = []


if next_flag:

    
    # Get layer
    all_layers = rs.LayerNames()
    
    for layer in all_layers:
        
        # main edge layer
        if "structure_model::edge::main::" in layer:
            split_layer = layer.split(":")
            main_edge_layer.append(split_layer[6])
        
        # sub edge layer
        if "structure_model::edge::sub::" in layer:
            split_layer = layer.split(":")
            sub_edge_layer.append(split_layer[6])
        
        # divided main edge layer
        if "structure_model::edge::split_main::" in layer:
            split_layer = layer.split(":")
            
            if len(split_layer) >= 9:
                divided_main_edge_layer.append(split_layer[8])
        
        # split_master_main_edge_layer
        if "structure_model::split_master_edge::master_main_split::" in layer:
            split_layer = layer.split(":")
            
            if len(split_layer) >= 9:
                split_master_main_edge_layer.append(split_layer[8])
        
        # split_master_sub_edge_layer
        if "structure_model::split_master_edge::master_sub_split::" in layer:
            split_layer = layer.split(":")
            
            if len(split_layer) >= 9:
                split_master_sub_edge_layer.append(split_layer[8])
        
        # bolt layer
        if "bolt::" in layer:
            split_layer = layer.split(":")
            bolt_layer.append(split_layer[4])
        
        # split main edge layer
        if "structure_model::split_edge::main_split::" in layer:
            split_layer = layer.split(":")
            
            if len(split_layer) >= 9:
                split_main_edge_layer.append(split_layer[8])
    
        # split sub edge layer
        if "structure_model::split_edge::sub_split::" in layer:
            split_layer = layer.split(":")
            
            if len(split_layer) >= 9:
                split_sub_edge_layer.append(split_layer[8])
# ---------- end python ----------

# ---- group: From instance
python_2 = GhPythonScript()  # -> nodal_pts_x, support_pts_x, mid_pts_x, mid_pts_x_split_edges, boundary_pts_z, timber_id_text_list, timber_id_point_list, segmented_pts_on_main_center_line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
# ---------- python_2: Python ----------
# coding: utf-8

import os
import sys
import time
import pickle
import rhinoscriptsyntax as rs
import Rhino
import scriptcontext as sc
#from playground import *


# Playground instance
file_path = r"G:\マイドライブ\2021\04_Master\2104_GenerationAlgorithm\RhinoPython\binary_file\playground.binaryfile"


# Open Object information
with open(file_path, "rb") as web:

    # Load Playground instance
    playground = pickle.load(web)
    
    nodal_pts_x = []
    support_pts_x = []
    mid_pts_x = []
    mid_pts_x_split_edges = []
    
    for pt in playground.free_end_coordinates:
        nodal_pts_x.append(pt.X)
    
    for pt in playground.support_pt_coordinates:
        support_pts_x.append(pt.X)
    
    for pt in playground.mid_pt_coordinates:
        mid_pts_x.append(pt[0])
    
    for pt in playground.mid_pt_coordinates_on_split_edges:
        mid_pts_x_split_edges.append(pt[0])
    
    # Boundary points
    boundary_pts_z = []
    
    for pt in playground.boundary_pts:
        boundary_pts_z.append(pt.Z)
    
    # Timber dot id text
    timber_id_text_list = []
    timber_id_point_list = []
    
    for timber in playground.timbers_in_structure:
        timber_id_text_list.append(timber.id)
        timber_id_point_list.append(timber.center_line.PointAt(0))
    
    # Timber segmtented points
    segmented_pts_on_main_center_line = []
    segmented_pts_on_sub_center_line = []
    segmented_pts_on_main_edge = []
    segmented_pts_on_sub_edge = []
    
    # main
    for main_edge in playground.main_edges_in_structure:
        
        print main_edge.id
        
        for pt in main_edge.segmented_pts:
            segmented_pts_on_main_center_line.append(pt)
        
        for pt in main_edge.segmented_pts_on_master_edge:
            segmented_pts_on_main_edge.append(pt)
            
    # sub
    for sub_edges in playground.sub_edges_in_structure:
        
        for sub_edge in sub_edges:
            for pt in sub_edge.segmented_pts:
                segmented_pts_on_sub_center_line.append(pt)
            
            for pt in sub_edge.segmented_pts_on_master_edge:
                segmented_pts_on_sub_edge.append(pt)
# ---------- end python_2 ----------

# ----
python_3 = GhPythonScript(pattern=list)  # -> mid_pt_type, nodal_type, segmented_pt_type
# ---------- python_3: Python ----------
import rhinoscriptsyntax as rs

mid_pt_type = -1
nodal_type = -1
segmented_pt_type = -1

if pattern == 0:
    mid_pt_type = 0
    nodal_type = 0

elif pattern == 1:
    mid_pt_type = 0
    nodal_type = 1

elif pattern == 2:
    mid_pt_type = 0
    nodal_type = 1
    segmented_pt_type = 1

elif pattern == 3:
    mid_pt_type = 1
    nodal_type = 1
    segmented_pt_type = 0
# ---------- end python_3 ----------
panel = Panel(python.split_master_main_edge_layer)
panel_2 = Panel(python.split_master_sub_edge_layer)
panel_3 = Panel(python.sub_edge_layer)
panel_4 = Panel(python.divided_main_edge_layer)
panel_5 = Panel(python.split_sub_edge_layer)
panel_6 = Panel(python.main_edge_layer)
panel_7 = Panel(python.bolt_layer)
panel_8 = Panel(python.split_main_edge_layer)
filter = StreamFilter(Gate=python_3.mid_pt_type, Stream0=python_2.mid_pts_x, Stream1=python_2.mid_pts_x_split_edges)

# ---- group: Normal Frame
relay = Relay([panel_6, panel_3])

# ---- group: Normal Frame_split-main
relay_2 = Relay([panel_3, panel_4])

# ---- group: Split Frame Model
relay_3 = Relay([panel_5, panel_8])

# ---- group: Normal Frame split
relay_4 = Relay([panel, panel_2])

# ----
panel_9 = Panel(python_2.nodal_pts_x)
panel_10 = Panel(filter)
filter_2 = StreamFilter(Gate=list, Stream0=relay, Stream1=relay_2, Stream2=relay_4, Stream3=relay_3)
readbeam2 = ReadBeam2(
    LayerBeam=filter_2,
    NameMat="mat",
    NameSec="sec",
    NameAngle="angle",
    NameJoint="joint",
    NameLb=["lby", "lbz"],
    NameBar="bar",
    NameWick=["wickX", "wickY"],
    NameEle_w=["ele_wx", "ele_wy", "ele_wz"],
    LayerSpring=panel_7,
    NameK=["kxt", "kxc", "kyt", "kyc", "kzt", "kzc", "mx", "my", "mz"],
    NameAngleSpring="angle",
    NameSpring_a=["Nta", "Nca", "Qyta", "Qyca", "Qzta", "Qzca", "Mxa", "Mya", "Mza"],
    RigidPinValue=[1e+12, 0.001],
    Accuracy=0.005)  # -> Beam, Mat, Sec, Angle, Joint, Lby, Lbz, Bar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
assemblegeometries = AssembleIJAndIJKL(
    Lines=readbeam2.Beam,
    MaterialNoList=readbeam2.Mat,
    SectionNoList=readbeam2.Sec,
    ElementAngleList=readbeam2.Angle,
    MaterialNoListShell=-9999,
    ThicknessList=-9999,
    Springs=readbeam2.Slines,
    E=readbeam2.E,
    KCa=-9999)  # -> Nodal_coordinates, Element_node_relationship, Element_node_relationshipShell, Element_node_relationshipSpring, Damper
nodalload = SetNodalLoads(
    Nodal_coordinates=assemblegeometries.Nodal_coordinates,
    XCoordinates=panel_10,
    YCoordinates=-9999,
    ZCoordinates=-9999,
    AxialLoadOfXAxisDirection=0,
    AxialLoadOfYAxisDirection=0,
    AxialLoadOfZAxisDirection=Slider(-0.5, range=-1..0),
    MomentLoadAroundXAxisDirection=0,
    MomentLoadAroundYAxisDirection=0,
    MomentLoadAroundZAxisDirection=0)
nodalload_2 = SetNodalLoads(
    Nodal_coordinates=assemblegeometries.Nodal_coordinates,
    XCoordinates=panel_9,
    YCoordinates=-9999,
    ZCoordinates=-9999,
    AxialLoadOfXAxisDirection=0,
    AxialLoadOfYAxisDirection=0,
    AxialLoadOfZAxisDirection=Slider(-0.5, range=-1..0),
    MomentLoadAroundXAxisDirection=0,
    MomentLoadAroundYAxisDirection=0,
    MomentLoadAroundZAxisDirection=0)
python_4 = GhPythonScript(xyz=assemblegeometries.Nodal_coordinates, boundary_pts_z=python_2.boundary_pts_z)  # -> edit_xyz; inputs xyz: list, boundary_pts_z: list
# ---------- python_4: Python ----------
import rhinoscriptsyntax as rs

# if condition satisfied, edit coordinate
if xyz[2] in boundary_pts_z:
    xyz[2] = 0

edit_xyz = xyz
# ---------- end python_4 ----------
assembletree = AssembleTree(Tree=nodalload_2, Tree_2=nodalload, Tree_3=-9999, Tree_4=-9999, Tree_5=-9999)
python_5 = GhPythonScript(lby=readbeam2.Lby, lbz=readbeam2.Lbz)  # -> edit_lby, edit_lbz
# ---------- python_5: Python ----------
import rhinoscriptsyntax as rs

#print x, y

edit_lby = (lby / 1000)   
edit_lbz = (lbz / 1000)

#print edit_lby, edit_lbz
# ---------- end python_5 ----------
boundary = SetBoundaryCondition(Nodal_coordinates=python_4, XCoordinates=-9999, YCoordinates=-9999, ZCoordinates="0.0")
filter_3 = StreamFilter(Gate=python_3.nodal_type, Stream0=nodalload_2, Stream1=assembletree)
visualizemodel = VisualizeStructuralModel(
    Nodal_coordinates=assemblegeometries.Nodal_coordinates,
    Element_node_relationship=assemblegeometries.Element_node_relationship,
    Element_node_relationshipShell=-9999,
    KABE_W=-9999,
    Nodal_force=filter_3,
    Line_force=-9999,
    Surface_force=-9999,
    Boundary_condition=boundary,
    JointCondition=-9999,
    SpringElement=assemblegeometries.Element_node_relationshipSpring,
    Index=-9999,
    IndexShell=-9999,
    IndexKabe=-9999,
    IndexSpring=-9999,
    Fontsize=10,
    Arrowsize=0.1,
    Arcsize=0.25)  # -> Nodal_coordinates, Element_node_relationship, Element_node_relationshipShell, KABE_W, Nodal_force, Line_force, Surface_force, Boundary_condition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
path = FilePath("G:\マイドライブ\2021\04_Master\2104_GenerationAlgorithm\StructualAnalysis\00_Asset\materiallist.csv")
elevec = CalcElementAxisVector(Nodal_coordinates=visualizemodel.Nodal_coordinates, Element_node_relationship=visualizemodel.Element_node_relationship)
material = SetMaterialParameters(Filename=path)  # -> E, Poi, Rho, Fc, Ft, Fb, Fs, F
path_2 = FilePath("G:\マイドライブ\2021\04_Master\2104_GenerationAlgorithm\RhinoPython\section_list\section_list.csv")
cross_sec_perf = CalcSectionPerformance(
    SectionType="2",
    Parameter1=Slider(0.1, range=0.05..0.5),
    Parameter2="0",
    Parameter3="0",
    Parameter4="0",
    Nodal_coordinates=visualizemodel.Nodal_coordinates,
    Element_node_relationship=visualizemodel.Element_node_relationship,
    ElementAxisVector=elevec,
    Fontsize=10,
    Unit_of_length="mm",
    Filename=path_2,
    Index=-9999)  # -> SectionArea, SecondMomentOfAreaAroundYAxis, SecondMomentOfAreaAroundZAxis, StVenantsTorsionConstant, SectionModulusAroundYAxis, SectionModulusAroundZAxis, VA, RenderingShape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
assembleloads = AssembleNodalElementAndSurfaceLoads(
    Nodal_coordinates=visualizemodel.Nodal_coordinates,
    Element_node_relationship=visualizemodel.Element_node_relationship,
    JointCondition=-9999,
    Nodal_load=visualizemodel.Nodal_force,
    Element_load=-9999,
    Floor_load=-9999,
    Surface_load=-9999,
    Wall_load=-9999,
    SectionArea=-9999,
    WeightDensity=material.Rho,
    Accuracy=1e-10)  # -> Nodal_load, Nodal_loadLocalCoordinateSystem, Nodal_coordinatesConsideringJoints
panel_11 = Panel(cross_sec_perf.SectionArea)
elastic_analysis = AnalysisUsingOpenSees(
    Nodal_coordinates=visualizemodel.Nodal_coordinates,
    Element_node_relationship=visualizemodel.Element_node_relationship,
    Element_node_relationshipShell=-9999,
    KABE_W=-9999,
    Nodal_force=assembleloads.Nodal_load,
    Boundary_condition=visualizemodel.Boundary_condition,
    LocalCoordinatesVector=elevec,
    JointCondition=visualizemodel.JointCondition,
    SpringElement=visualizemodel.SpringElement,
    YoungsMudulus=material.E,
    ShearModulus=material.Poi,
    SectionArea=cross_sec_perf.SectionArea,
    SecondMomentOfAreaAroundYAxis=cross_sec_perf.SecondMomentOfAreaAroundYAxis,
    SecondMomentOfAreaAroundZAxis=cross_sec_perf.SecondMomentOfAreaAroundZAxis,
    StVenantsTorsionConstant=cross_sec_perf.StVenantsTorsionConstant,
    Nodal_forceLocalCoordinateSystem=assembleloads.Nodal_loadLocalCoordinateSystem,
    Step=1,
    Option=[1, 1])  # -> R, IJ, D, reac_f, sec_f, l_vec, IJKL, D_shell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
panel_12 = Panel(elastic_analysis.sec_f)
python_6 = GhPythonScript(sec_f=elastic_analysis.sec_f)  # -> sec_f; inputs sec_f: list
# ---------- python_6: Python ----------
import rhinoscriptsyntax as rs

bend_f_index = [3, 4, 5, 9, 10, 11, 15, 16, 17]

sec_f = sec_f

for i, sec_force in enumerate(sec_f):
    if i in bend_f_index:
        print float(sec_f[i]) * (10 ** -3)
        
        sec_f[i] = float(sec_f[i]) * (10 ** -3)
# ---------- end python_6 ----------
panel_13 = Panel(python_6)
visualizeresult = VisualizeAnalysisResult(
    Nodal_coordinates=elastic_analysis.R,
    Element_node_relationship=elastic_analysis.IJ,
    Nodal_displacements=elastic_analysis.D,
    Reaction_force=elastic_analysis.reac_f,
    Section_force=python_6,
    ElementAxisVector=elastic_analysis.l_vec,
    KABE_W=-9999,
    Shear_w=-9999,
    Index=-9999,
    IndexKabe=-9999,
    Divide_display_points=30,
    Scale_factor_for_disp=Slider(1e-05, range=0..1e-05),
    Scale_factor_for_NQ=Slider(142, range=10..300),
    Scale_factor_for_M=Slider(706.68, range=0.01..1000),
    Fontsize=12,
    Arcsize=0.25)  # -> Nodal_coordinates, Element_node_relationship, Section_force, KABE_W, Shear_w
timbercheck = AllowableStressDesignForTimberBeams(
    Nodal_coordinates=visualizeresult.Nodal_coordinates,
    Element_node_relationship=visualizeresult.Element_node_relationship,
    SectionArea=cross_sec_perf.SectionArea,
    SecondMomentOfAreaAroundYAxis=cross_sec_perf.SecondMomentOfAreaAroundYAxis,
    SecondMomentOfAreaAroundZAxis=cross_sec_perf.SecondMomentOfAreaAroundZAxis,
    SectionModulusAroundYAxis=cross_sec_perf.SectionModulusAroundYAxis,
    SectionModulusAroundZAxis=cross_sec_perf.SectionModulusAroundZAxis,
    StandardAllowableStressCompression_N_mm2=material.Fc,
    StandardAllowableStressTensile_N_mm2=material.Ft,
    StandardAllowableStressBending_N_mm2=material.Fb,
    StandardAllowableStressShear_N_mm2=material.Fs,
    Lby=python_5.edit_lby,
    Lbz=python_5.edit_lbz,
    Sectional_force=visualizeresult.Section_force,
    SafeFactor=0.75,
    KABE_W=-9999,
    Shear_w=-9999,
    Index=-9999,
    IndexKabe=-9999,
    IndexBurn=-9999,
    BurnB=-9999,
    BurnD=-9999,
    Fontsize=10)  # -> Index, IJ, Lambda, Fk, Ft, Fb, Fs, SafeFactor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
