# Grasshopper definition structural_analysis_AR.gh (Grasshopper 1.0.7)
# plug-ins: Fologram For Grasshopper Utilities, FologramForGrasshopper, OpenSeesUtility

reload = Button()
file = ReadFile(File="G:\マイドライブ\2020\04_Master\2006_Generation-algorithm\RhinoPython\load_instance.py", PerLineParse=False)
syncparams = SyncParameters(
    augmented_trigger_0_key=number_slider_2,
    augmented_trigger_10_key=number_slider_3,
    augmented_trigger_11_key=number_slider_14,
    augmented_trigger_17_key=number_slider_19,
    augmented_trigger_1_key=number_slider_6,
    augmented_trigger_23_key=list_2,
    augmented_trigger_24_key=_03_fix_base_target_line,
    augmented_trigger_27_key=number_slider_12,
    augmented_trigger_28_key=number_slider_13,
    augmented_trigger_29_key=number_slider_10,
    augmented_trigger_2_key=number_slider_9,
    augmented_trigger_30_key=number_slider_11,
    augmented_trigger_33_key=reload,
    augmented_trigger_36_key=number_slider_18,
    augmented_trigger_37_key=number_slider_15,
    augmented_trigger_38_key=number_slider_16,
    augmented_trigger_3_key=number_slider_8,
    augmented_trigger_41_key=number_slider_17,
    augmented_trigger_4_key=number_slider_7,
    augmented_trigger_5_key=number_slider,
    augmented_trigger_6_key=list,
    augmented_trigger_8_key=number_slider_5,
    augmented_trigger_9_key=number_slider_4,
    componentVersion=1,
    num_augmented_triggers=42)
path = FilePath("G:\マイドライブ\2020\04_Master\2006_Generation-algorithm\RhinoPython\section_list\section_list.csv")
path_2 = FilePath("G:\マイドライブ\2020\04_Master\2006_Generation-algorithm\RhinoPython\binary_file\playground.binaryfile")

# ---- group: Select Frame Model Type
list = ValueList({"Line Frame(Load on sub edge)": 0, "Line Frame(Load on main and sub edge)": 1, "Segmented Line Frame(Load on main and sub edge)": 2, "Segmented Polyline Frame(Load on main and sub edge)": 3}, selected="Segmented Polyline Frame(Load on main and sub edge)")

# ----
python = GhPythonScript(Code=file, Binary_file_path=path_2, Section_list_path=path, Reload_flag=reload)  # -> Out, Next_flag, Playground_instance
rec = DataRecorder(python.Next_flag, DataLimit=2, RecordData=True)
rec_2 = DataRecorder(python.Playground_instance, DataLimit=2, RecordData=True)
panel = Panel(python.Out)
panel_2 = Panel(rec)
split = SplitList(List=panel_2, Index="1")  # -> ListA, ListB
split_2 = SplitList(List=rec_2, Index="1")  # -> ListA, ListB
panel_3 = Panel(split_2.ListA)
panel_4 = Panel(split.ListA)
python_2 = GhPythonScript(next_flag=panel_4)  # -> main_edge_layer, sub_edge_layer, divided_main_edge_layer, split_master_main_edge_layer, split_master_sub_edge_layer, bolt_layer, split_main_edge_layer, split_sub_edge_layer
# ---------- python_2: Python ----------
import scriptcontext as sc
import Rhino as rh
import rhinoscriptsyntax as rs

# Set the directory of document
# https://qiita.com/jhorikawa_err/items/827a83033083507bed91
sc.doc = rh.RhinoDoc.ActiveDoc 

# Nomal Frame Model
main_edge_layer = []
sub_edge_layer = []
divided_main_edge_layer = []

split_master_main_edge_layer = []
split_master_sub_edge_layer = []

# Split Frame Model
split_main_edge_layer = []
split_sub_edge_layer = []

bolt_layer = []


if next_flag:

    
    # Get layer
    all_layers = rs.LayerNames()
    
    for layer in all_layers:
        
        # main edge layer
        if "structure_model::edge::main::" in layer:
            split_layer = layer.split(":")
            main_edge_layer.append(split_layer[6])
        
        # sub edge layer
        if "structure_model::edge::sub::" in layer:
            split_layer = layer.split(":")
            sub_edge_layer.append(split_layer[6])
        
        # divided main edge layer
        if "structure_model::edge::split_main::" in layer:
            split_layer = layer.split(":")
            
            if len(split_layer) >= 9:
                divided_main_edge_layer.append(split_layer[8])
        
        # split_master_main_edge_layer
        if "structure_model::split_master_edge::master_main_split::" in layer:
            split_layer = layer.split(":")
            
            if len(split_layer) >= 9:
                split_master_main_edge_layer.append(split_layer[8])
        
        # split_master_sub_edge_layer
        if "structure_model::split_master_edge::master_sub_split::" in layer:
            split_layer = layer.split(":")
            
            if len(split_layer) >= 9:
                split_master_sub_edge_layer.append(split_layer[8])
        
        # bolt layer
        if "bolt::" in layer:
            split_layer = layer.split(":")
            bolt_layer.append(split_layer[4])
        
        # split main edge layer
        if "structure_model::split_edge::main_split::" in layer:
            split_layer = layer.split(":")
            
            if len(split_layer) >= 9:
                split_main_edge_layer.append(split_layer[8])
    
        # split sub edge layer
        if "structure_model::split_edge::sub_split::" in layer:
            split_layer = layer.split(":")
            
            if len(split_layer) >= 9:
                split_sub_edge_layer.append(split_layer[8])
# ---------- end python_2 ----------

# ---- group: From instance
python_3 = GhPythonScript(flag=panel_4)  # -> nodal_pts_x, support_pts_x, mid_pts_x, mid_pts_x_split_edges, boundary_pts_z, timber_id_text_list, timber_id_point_list, segmented_pts_on_main_center_line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
# ---------- python_3: Python ----------
# coding: utf-8

import os
import sys
import time
import pickle
import rhinoscriptsyntax as rs
import Rhino
import scriptcontext as sc
from playground import *



# Playground instance
file_path = r"G:\マイドライブ\2020\04_Master\2006_Generation-algorithm\RhinoPython\binary_file\playground.binaryfile"


if flag:

    # Open Object information
    with open(file_path, "rb") as web:
    
        # Load Playground instance
        playground = pickle.load(web)
        
        nodal_pts_x = []
        support_pts_x = []
        mid_pts_x = []
        mid_pts_x_split_edges = []
        
        for pt in playground.free_end_coordinates:
            nodal_pts_x.append(pt.X)
        
        for pt in playground.support_pt_coordinates:
            support_pts_x.append(pt.X)
        
        for pt in playground.mid_pt_coordinates:
            mid_pts_x.append(pt[0])
        
        for pt in playground.mid_pt_coordinates_on_split_edges:
            mid_pts_x_split_edges.append(pt[0])
        
        # Boundary points
        boundary_pts_z = []
        
        for pt in playground.boundary_pts:
            boundary_pts_z.append(pt.Z)
        
        # Timber dot id text
        timber_id_text_list = []
        timber_id_point_list = []
        
        for timber in playground.timbers_in_structure:
            timber_id_text_list.append(timber.id)
            timber_id_point_list.append(timber.center_line.PointAt(0))
        
        # Timber segmtented points
        segmented_pts_on_main_center_line = []
        segmented_pts_on_sub_center_line = []
        segmented_pts_on_main_edge = []
        segmented_pts_on_sub_edge = []
        
        # main
        for main_edge in playground.main_edges_in_structure:
            
            print main_edge.id
            
            for pt in main_edge.segmented_pts:
                segmented_pts_on_main_center_line.append(pt)
            
            for pt in main_edge.segmented_pts_on_master_edge:
                segmented_pts_on_main_edge.append(pt)
                
        # sub
        for sub_edges in playground.sub_edges_in_structure:
            
            for sub_edge in sub_edges:
                for pt in sub_edge.segmented_pts:
                    segmented_pts_on_sub_center_line.append(pt)
                
                for pt in sub_edge.segmented_pts_on_master_edge:
                    segmented_pts_on_sub_edge.append(pt)
# ---------- end python_3 ----------

# ----
python_4 = GhPythonScript(pattern=list)  # -> mid_pt_type, nodal_type, segmented_pt_type
# ---------- python_4: Python ----------
import rhinoscriptsyntax as rs

mid_pt_type = -1
nodal_type = -1
segmented_pt_type = -1

if pattern == 0:
    mid_pt_type = 0
    nodal_type = 0

elif pattern == 1:
    mid_pt_type = 0
    nodal_type = 1

elif pattern == 2:
    mid_pt_type = 0
    nodal_type = 1
    segmented_pt_type = 1

elif pattern == 3:
    mid_pt_type = 1
    nodal_type = 1
    segmented_pt_type = 0
# ---------- end python_4 ----------
panel_5 = Panel(python_2.split_master_main_edge_layer)
panel_6 = Panel(python_2.split_master_sub_edge_layer)
panel_7 = Panel(python_2.sub_edge_layer)
panel_8 = Panel(python_2.divided_main_edge_layer)
panel_9 = Panel(python_2.split_sub_edge_layer)
panel_10 = Panel(python_2.main_edge_layer)
panel_11 = Panel(python_2.bolt_layer)
panel_12 = Panel(python_2.split_main_edge_layer)
filter = StreamFilter(Gate=python_4.mid_pt_type, Stream0=python_3.mid_pts_x, Stream1=python_3.mid_pts_x_split_edges)

# ---- group: Normal Frame
relay = Relay([panel_10, panel_7])

# ---- group: Normal Frame_split-main
relay_2 = Relay([panel_7, panel_8])

# ---- group: Split Frame Model
relay_3 = Relay([panel_9, panel_12])

# ---- group: Normal Frame split
relay_4 = Relay([panel_5, panel_6])

# ----
panel_13 = Panel(python_3.nodal_pts_x)
panel_14 = Panel(filter)
filter_2 = StreamFilter(Gate=list, Stream0=relay, Stream1=relay_2, Stream2=relay_4, Stream3=relay_3)
number_slider = Slider(-0.5, range=-1..0)
number_slider_2 = Slider(-0.5, range=-1..0)
readbeam2 = ReadBeam2(
    LayerBeam=filter_2,
    NameMat="mat",
    NameSec="sec",
    NameAngle="angle",
    NameJoint="joint",
    NameLb=["lby", "lbz"],
    NameBar="bar",
    NameWick=["wickX", "wickY"],
    NameEle_w=["ele_wx", "ele_wy", "ele_wz"],
    LayerSpring=panel_11,
    NameK=["kxt", "kxc", "kyt", "kyc", "kzt", "kzc", "mx", "my", "mz"],
    NameAngleSpring="angle",
    NameSpring_a=["Nta", "Nca", "Qyta", "Qyca", "Qzta", "Qzca", "Mxa", "Mya", "Mza"],
    RigidPinValue=[1e+12, 0.001])  # -> Beam, Mat, Sec, Angle, Joint, Lby, Lbz, Bar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
assemblegeometries = AssembleIJAndIJKL(
    Lines=readbeam2.Beam,
    MaterialNoList=readbeam2.Mat,
    SectionNoList=readbeam2.Sec,
    ElementAngleList=readbeam2.Angle,
    MaterialNoListShell=-9999,
    ThicknessList=-9999,
    Springs=readbeam2.Slines,
    E=readbeam2.E)  # -> Nodal_coordinates, Element_node_relationship, Element_node_relationshipShell, Element_node_relationshipSpring
nodalload = SetNodalLoads(
    Nodal_coordinates=assemblegeometries.Nodal_coordinates,
    XCoordinates=panel_14,
    YCoordinates=-9999,
    ZCoordinates=-9999,
    AxialLoadOfXAxisDirection=0,
    AxialLoadOfYAxisDirection=0,
    AxialLoadOfZAxisDirection=number_slider,
    MomentLoadAroundXAxisDirection=0,
    MomentLoadAroundYAxisDirection=0,
    MomentLoadAroundZAxisDirection=0)
nodalload_2 = SetNodalLoads(
    Nodal_coordinates=assemblegeometries.Nodal_coordinates,
    XCoordinates=panel_13,
    YCoordinates=-9999,
    ZCoordinates=-9999,
    AxialLoadOfXAxisDirection=0,
    AxialLoadOfYAxisDirection=0,
    AxialLoadOfZAxisDirection=number_slider_2,
    MomentLoadAroundXAxisDirection=0,
    MomentLoadAroundYAxisDirection=0,
    MomentLoadAroundZAxisDirection=0)
python_5 = GhPythonScript(xyz=assemblegeometries.Nodal_coordinates, boundary_pts_z=python_3.boundary_pts_z)  # -> edit_xyz; inputs xyz: list, boundary_pts_z: list
# ---------- python_5: Python ----------
import rhinoscriptsyntax as rs

# if condition satisfied, edit coordinate
if xyz[2] in boundary_pts_z:
    xyz[2] = 0

edit_xyz = xyz
# ---------- end python_5 ----------
assembletree = AssembleTree(Tree=nodalload_2, Tree_2=nodalload, Tree_3=-9999, Tree_4=-9999, Tree_5=-9999)
python_6 = GhPythonScript(lby=readbeam2.Lby, lbz=readbeam2.Lbz)  # -> edit_lby, edit_lbz
# ---------- python_6: Python ----------
import rhinoscriptsyntax as rs

#print x, y

edit_lby = (lby / 1000)   
edit_lbz = (lbz / 1000)

#print edit_lby, edit_lbz
# ---------- end python_6 ----------
boundary = SetBoundaryCondition(Nodal_coordinates=python_5, XCoordinates=-9999, YCoordinates=-9999, ZCoordinates="0.0")
filter_3 = StreamFilter(Gate=python_4.nodal_type, Stream0=nodalload_2, Stream1=assembletree)

# ---- group: Timber_Edge
panel_15 = Panel(readbeam2.Names)
flatten = FlattenTree(Tree=panel_15, Path="{0}")
python_7 = GhPythonScript(layer_names=flatten)  # -> color_list; inputs layer_names: list
# ---------- python_7: Python ----------
import rhinoscriptsyntax as rs
import scriptcontext
import Rhino

color_list = []

for layer_name in layer_names:

    # Get specific object by using layer name
    rhobjs = scriptcontext.doc.Objects.FindByLayer(layer_name)
    
    for obj in rhobjs:
        
        color_name = rs.GetUserText(obj, "color")
        
        if color_name == "red":
            color = rs.CreateColor([223, 51, 78])
            
        elif color_name == "yellow":
            color = rs.CreateColor([255, 255, 0])
            
        elif color_name == "blue":
            color = rs.CreateColor([0, 0, 255])
            
        elif color_name == "orange":
            color = rs.CreateColor([255, 140, 0])
            
        else:
            color = rs.CreateColor([0, 0, 0])
        
        color_list.append(color)
# ---------- end python_7 ----------
sync = SyncObject(
    GM=readbeam2.Beam,
    AlwaysIncludeTextureCoordinates=False,
    Clickable=True,
    DefaultCurveThicknessMillimeters=2.5,
    DefaultGlossPercent=0,
    DefaultMaterialColor=RGB(255, 255, 255),
    DefaultSpecularPercent=0,
    Grabbable=False,
    Interactive=False,
    Occlusion=False,
    Outline=False,
    hasSerializedData=True)
syncmat = SyncMaterial(Material=python_7, hasSerializedData=True)
assignmat = AssignMaterial(SynchronizedGeometry=sync, SynchronizedMaterial=syncmat)

# ---- group: Timber id text
number_slider_3 = Slider(40, range=10..100)
synctag = SyncTextTag(Text=python_3.timber_id_text_list, Point=python_3.timber_id_point_list, Size=number_slider_3, hasSerializedData=True)

# ---- group: Timber Surface
number_slider_4 = Slider(0.5, range=0..1)
python_8 = GhPythonScript(run_flag=panel_4)  # -> timber_surface_list, color_list
# ---------- python_8: Python ----------
import scriptcontext as sc
import Rhino as rh
import rhinoscriptsyntax as rs
import re

timber_surface_list = []
color_list = []

if run_flag:

    # Get layer
    all_layers = rs.LayerNames()
    
    for layer in all_layers:
        # About Timber surface
        pattern = "playground::[0-9]{1,3}::split timber::[0-9]{1,3}-[0-9]{1,3}"
        result = re.findall(pattern, layer)
        
        if result:
            split_layer = layer.split(":")
            
            if len(split_layer) == 7:
                # timber surface
                value = split_layer[-1]
                rhobjs = sc.doc.Objects.FindByUserString("id", str(value), False)
                
                for obj in rhobjs:
                    timber_surface_list.append(obj.Geometry)
                
                    # timber color
                    color_id = rs.GetUserText(obj, "color")
                    
                    if color_id == "0":  
                        color = rs.CreateColor([223, 51, 78])  # red
                        
                    elif color_id == "1":
                        color = rs.CreateColor([255, 255, 0])  # yellow
                        
                    elif color_id == "2":
                        color = rs.CreateColor([157, 204, 255])  # blue
                        
                    elif color_id == "3":
                        color = rs.CreateColor([255, 140, 0])  # orange
                        
                    else:
                        color = rs.CreateColor([0, 0, 0])
    
                    color_list.append(color)
                
        # About Timber id
        pattern = "playground::[0-9]{1,3}::text id"
        result = re.findall(pattern, layer)
        
#        if result:
#            print layer
        
        
    print len(timber_surface_list)
    print len(color_list)
# ---------- end python_8 ----------
number_slider_5 = Slider(0, range=0..100)
material = CreateMaterial(
    Diffuse=python_8.color_list,
    Specular=RGB(255, 255, 255),
    Emission=RGB(0, 0, 0),
    Transparency=number_slider_4,
    Shine=number_slider_5)
sync_2 = SyncObject(
    GM=python_8.timber_surface_list,
    AlwaysIncludeTextureCoordinates=False,
    Clickable=False,
    DefaultCurveThicknessMillimeters=2.5,
    DefaultGlossPercent=0,
    DefaultMaterialColor=RGB(255, 255, 255),
    DefaultSpecularPercent=0,
    Grabbable=False,
    Interactive=False,
    Occlusion=False,
    Outline=False,
    hasSerializedData=True)
syncmat_2 = SyncMaterial(Material=material, hasSerializedData=True)
assignmat_2 = AssignMaterial(SynchronizedGeometry=sync_2, SynchronizedMaterial=syncmat_2)

# ----
visualizemodel = VisualizeStructuralModel(
    Nodal_coordinates=assemblegeometries.Nodal_coordinates,
    Element_node_relationship=assemblegeometries.Element_node_relationship,
    Element_node_relationshipShell=-9999,
    KABE_W=-9999,
    Nodal_force=filter_3,
    Line_force=-9999,
    Surface_force=-9999,
    Boundary_condition=boundary,
    JointCondition=-9999,
    SpringElement=assemblegeometries.Element_node_relationshipSpring,
    Index=-9999,
    IndexShell=-9999,
    IndexKabe=-9999,
    IndexSpring=-9999,
    Fontsize=10,
    Arrowsize=0.1,
    Arcsize=0.25)  # -> Nodal_coordinates, Element_node_relationship, Element_node_relationshipShell, KABE_W, Nodal_force, Line_force, Surface_force, Boundary_condition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

# ---- group: Bolt_Edge
rgb = ColourRGB(Alpha=255, Red=0, Green=0, Blue=0)
sync_3 = SyncObject(
    GM=readbeam2.Slines,
    AlwaysIncludeTextureCoordinates=False,
    Clickable=False,
    DefaultCurveThicknessMillimeters=2.5,
    DefaultGlossPercent=0,
    DefaultMaterialColor=RGB(255, 255, 255),
    DefaultSpecularPercent=0,
    Grabbable=False,
    Interactive=False,
    Occlusion=False,
    Outline=False,
    hasSerializedData=True)
syncmat_3 = SyncMaterial(Material=rgb, hasSerializedData=True)
assignmat_3 = AssignMaterial(SynchronizedGeometry=sync_3, SynchronizedMaterial=syncmat_3)

# ----
number_slider_6 = Slider(0.1, range=0.05..0.5)
path_3 = FilePath("G:\マイドライブ\2020\04_Master\2006_Generation-algorithm\StructualAnalysis\201117\materiallist.csv")
elevec = CalcElementAxisVector(Nodal_coordinates=visualizemodel.Nodal_coordinates, Element_node_relationship=visualizemodel.Element_node_relationship)
material_2 = SetMaterialParameters(Filename=path_3)  # -> E, Poi, Rho, Fc, Ft, Fb, Fs, F
path_4 = FilePath("G:\マイドライブ\2020\04_Master\2006_Generation-algorithm\RhinoPython\section_list\section_list.csv")
cross_sec_perf = CalcSectionPerformance(
    SectionType="2",
    Parameter1=number_slider_6,
    Parameter2="0",
    Parameter3="0",
    Parameter4="0",
    Nodal_coordinates=visualizemodel.Nodal_coordinates,
    Element_node_relationship=visualizemodel.Element_node_relationship,
    ElementAxisVector=elevec,
    Fontsize=10,
    Unit_of_length="mm",
    Filename=path_4,
    Index=-9999)  # -> SectionArea, SecondMomentOfAreaAroundYAxis, SecondMomentOfAreaAroundZAxis, StVenantsTorsionConstant, SectionModulusAroundYAxis, SectionModulusAroundZAxis, VA, RenderingShape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
assembleloads = AssembleNodalElementAndSurfaceLoads(
    Nodal_coordinates=visualizemodel.Nodal_coordinates,
    Element_node_relationship=visualizemodel.Element_node_relationship,
    JointCondition=visualizemodel.JointCondition,
    Nodal_load=visualizemodel.Nodal_force,
    Element_load=-9999,
    Floor_load=-9999,
    Surface_load=-9999,
    SectionArea=-9999,
    WeightDensity=material_2.Rho)  # -> Nodal_load, Nodal_loadLocalCoordinateSystem, Nodal_coordinatesConsideringJoints, Line
panel_16 = Panel(cross_sec_perf.SectionArea)
python_9 = GhPythonScript(
    A=cross_sec_perf.SectionArea,
    Iy=cross_sec_perf.SecondMomentOfAreaAroundYAxis,
    Iz=cross_sec_perf.SecondMomentOfAreaAroundZAxis,
    Zy=cross_sec_perf.SectionModulusAroundYAxis,
    Zz=cross_sec_perf.SectionModulusAroundZAxis)  # -> edit_A, edit_Iy, edit_Iz, edit_Zy, edit_Zz
# ---------- python_9: Python ----------
import rhinoscriptsyntax as rs

edit_A = A * (10 ** -6)
edit_Iy = Iy * (10 ** -12)
edit_Iz = Iz * (10 ** -12)
edit_Zy = Zy * (10 ** -9)
edit_Zz = Zz * (10 ** -9)

print Iy, edit_Iy
# ---------- end python_9 ----------
elastic_analysis = AnalysisUsingOpenSees(
    Nodal_coordinates=visualizemodel.Nodal_coordinates,
    Element_node_relationship=visualizemodel.Element_node_relationship,
    Element_node_relationshipShell=-9999,
    KABE_W=-9999,
    Nodal_force=assembleloads.Nodal_load,
    Boundary_condition=visualizemodel.Boundary_condition,
    LocalCoordinatesVector=elevec,
    JointCondition=visualizemodel.JointCondition,
    SpringElement=visualizemodel.SpringElement,
    YoungsMudulus=material_2.E,
    ShearModulus=material_2.Poi,
    SectionArea=cross_sec_perf.SectionArea,
    SecondMomentOfAreaAroundYAxis=cross_sec_perf.SecondMomentOfAreaAroundYAxis,
    SecondMomentOfAreaAroundZAxis=cross_sec_perf.SecondMomentOfAreaAroundZAxis,
    StVenantsTorsionConstant=cross_sec_perf.StVenantsTorsionConstant,
    Nodal_forceLocalCoordinateSystem=assembleloads.Nodal_loadLocalCoordinateSystem,
    Step=1,
    Option=[1, 1])  # -> R, IJ, D, reac_f, sec_f, l_vec, IJKL, D_shell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
panel_17 = Panel(elastic_analysis.sec_f)
python_10 = GhPythonScript(sec_f=elastic_analysis.sec_f)  # -> sec_f; inputs sec_f: list
# ---------- python_10: Python ----------
import rhinoscriptsyntax as rs

bend_f_index = [3, 4, 5, 9, 10, 11, 15, 16, 17]

sec_f = sec_f

for i, sec_force in enumerate(sec_f):
    if i in bend_f_index:
        print float(sec_f[i]) * (10 ** -3)
        
        sec_f[i] = float(sec_f[i]) * (10 ** -3)
# ---------- end python_10 ----------
number_slider_7 = Slider(1e-05, range=0..1e-05)
number_slider_8 = Slider(142, range=10..300)
number_slider_9 = Slider(189.9, range=0.01..1000)
panel_18 = Panel(python_10)
visualizeresult = VisualizeAnalysisResult(
    Nodal_coordinates=elastic_analysis.R,
    Element_node_relationship=elastic_analysis.IJ,
    Nodal_displacements=elastic_analysis.D,
    Reaction_force=elastic_analysis.reac_f,
    Section_force=python_10,
    ElementAxisVector=elastic_analysis.l_vec,
    KABE_W=-9999,
    Shear_w=-9999,
    Index=-9999,
    IndexKabe=-9999,
    Divide_display_points=30,
    Scale_factor_for_disp=number_slider_7,
    Scale_factor_for_NQ=number_slider_8,
    Scale_factor_for_M=number_slider_9,
    Fontsize=12,
    Arcsize=0.25)  # -> Nodal_coordinates, Element_node_relationship, Section_force, KABE_W, Shear_w, Lines_after_deformation
timbercheck = AllowableStressDesignForTimberBeams(
    Nodal_coordinates=visualizeresult.Nodal_coordinates,
    Element_node_relationship=visualizeresult.Element_node_relationship,
    SectionArea=cross_sec_perf.SectionArea,
    SecondMomentOfAreaAroundYAxis=cross_sec_perf.SecondMomentOfAreaAroundYAxis,
    SecondMomentOfAreaAroundZAxis=cross_sec_perf.SecondMomentOfAreaAroundZAxis,
    SectionModulusAroundYAxis=cross_sec_perf.SectionModulusAroundYAxis,
    SectionModulusAroundZAxis=cross_sec_perf.SectionModulusAroundZAxis,
    StandardAllowableStressCompression_N_mm2=material_2.Fc,
    StandardAllowableStressTensile_N_mm2=material_2.Ft,
    StandardAllowableStressBending_N_mm2=material_2.Fb,
    StandardAllowableStressShear_N_mm2=material_2.Fs,
    Lby=python_6.edit_lby,
    Lbz=python_6.edit_lbz,
    Sectional_force=visualizeresult.Section_force,
    SafeFactor=0.75,
    KABE_W=-9999,
    Shear_w=-9999,
    Index=-9999,
    IndexKabe=-9999,
    IndexBurn=-9999,
    BurnB=-9999,
    BurnD=-9999,
    Fontsize=10)  # -> Index, IJ, Lambda, Fk, Ft, Fb, Fs, SafeFactor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
panel_19 = Panel("空中タップを実装する")
number_slider_10 = Slider(29, range=0..100)
number_slider_11 = Slider(31, range=0..100)

# ---- group: segmented points
merge = Merge(Data1=python_3.segmented_pts_on_main_edge, Data2=python_3.segmented_pts_on_sub_edge)
merge_2 = Merge(Data1=python_3.segmented_pts_on_main_center_line, Data2=python_3.segmented_pts_on_sub_center_line)
filter_4 = StreamFilter(Gate=python_4.segmented_pt_type, Stream0=merge_2, Stream1=merge)

# ----
number_slider_12 = Slider(100, range=0..10000)
number_slider_13 = Slider(100, range=0..10000)
number_slider_14 = Slider(15, range=1..20)

number_slider_15 = Slider(29, range=0..100)
number_slider_16 = Slider(31, range=0..100)
number_slider_17 = Slider(15, range=0..100)
number_slider_18 = Slider(10, range=1..20)
sph = Sphere(Base=PlaneXY(0, 0, 0), Radius=number_slider_18)
arrbox = BoxArray(
    Geometry=sph,
    Cell={Plane=PlaneXY(0, 0, 0), X=Domain(0, 100), Y=Domain(0, 100), Z=Domain(0, 100)},
    XCount=number_slider_15,
    YCount=number_slider_16,
    ZCount=number_slider_17)  # -> Geometry, Transform
sync_4 = SyncObject(
    AlwaysIncludeTextureCoordinates=False,
    Clickable=False,
    DefaultCurveThicknessMillimeters=2.5,
    DefaultGlossPercent=0,
    DefaultMaterialColor=RGB(255, 255, 255),
    DefaultSpecularPercent=0,
    Grabbable=False,
    Interactive=False,
    Occlusion=False,
    Outline=False,
    hasSerializedData=True)

planesrf = PlaneSurface(Plane=PlaneXY(0, 0, 0), XSize=number_slider_12, YSize=number_slider_13)
neg = Negative(Value=number_slider_10)
arrrec = RectangularArray(Geometry=planesrf, Cell=planesrf, XCount=neg, YCount=number_slider_11)  # -> Geometry, Transform
sph_2 = Sphere(Base=filter_4, Radius=number_slider_14)
sync_5 = SyncObject(
    GM=sph_2,
    AlwaysIncludeTextureCoordinates=False,
    Clickable=True,
    DefaultCurveThicknessMillimeters=2.5,
    DefaultGlossPercent=0,
    DefaultMaterialColor=RGB(255, 255, 255),
    DefaultSpecularPercent=0,
    Grabbable=False,
    Interactive=False,
    Occlusion=False,
    Outline=False,
    hasSerializedData=True)
sync_6 = SyncObject(
    GM=arrrec.Geometry,
    AlwaysIncludeTextureCoordinates=False,
    Clickable=True,
    DefaultCurveThicknessMillimeters=2.5,
    DefaultGlossPercent=0,
    DefaultMaterialColor=RGB(255, 255, 255),
    DefaultSpecularPercent=0,
    Grabbable=False,
    Interactive=False,
    Occlusion=False,
    Outline=False,
    hasSerializedData=True)
area = Area(Geometry=arrrec.Geometry)  # -> Area, Centroid
list_2 = ValueList({"01. Select Two points": 0, "02. Fix Two Points": 2, "03. Undo Generation": 3}, selected="02. Fix Two Points")
merge_sync_obj = Merge(Data1=sync_5, Data2=sync_6)  # -> flatten(Result)
devices = ConnectedDevices(device_filter=3, hasSerializedData=True)
T = StateGate(States=list_2, LinkTarget=taps)  # -> _0, _1, _2, _3
taps = TrackTaps(
    Devices=flatten(devices),
    Geometry=flatten(merge_sync_obj),
    IncludeEmptyTaps=False,
    hasSerializedData=True,
    update_mode=2)  # -> Device, Index; disabled
index = Panel(taps.Index)
merge_coordinate = Merge(Data1=filter_4, Data2=area.Centroid)  # -> flatten(Result)
rec_3 = DataRecorder(index, DataLimit=3, RecordData=True)
item = ListItem(List=merge_coordinate, Index=index, Wrap=True)
panel_20 = Panel(item)
rec_4 = DataRecorder(item, DataLimit=2, RecordData=True)
split_3 = SplitList(List=rec_3, Index="1")  # -> ListA, flatten(ListB)
panel_21 = Panel(rec_4)

# ---- group: reset color
panel_22 = Panel(split_3.ListA)
item_2 = ListItem(List=merge_sync_obj, Index=panel_22, Wrap=True)
rgb_2 = ColourRGB(Alpha=255, Red=255, Green=255, Blue=255)
syncmat_4 = SyncMaterial(Material=rgb_2, hasSerializedData=True)
assignmat_4 = AssignMaterial(SynchronizedGeometry=item_2, SynchronizedMaterial=syncmat_4)

# ---- group: Selecting
panel_23 = Panel(split_3.ListB)
rgb_3 = ColourRGB(Alpha=255, Red=255, Green=0, Blue=0)
item_3 = ListItem(List=merge_sync_obj, Index=panel_23, Wrap=True)
syncmat_5 = SyncMaterial(Material=rgb_3, hasSerializedData=True)
assignmat_5 = AssignMaterial(SynchronizedGeometry=item_3, SynchronizedMaterial=syncmat_5)

# ----
item_4 = ListItem(List=panel_21, Index="1", Wrap=True)
item_5 = ListItem(List=panel_21, Index="0", Wrap=True)
ln = Line(StartPoint=item_5, EndPoint=item_4)
python_11 = GhPythonScript(x=item_5, y=item_4)  # -> desired_target_line, divide_pts; inputs x: Point3d, y: Point3d
# ---------- python_11: Python ----------
import rhinoscriptsyntax as rs
import scriptcontext
import Rhino
from Rhino.Geometry import *



def generate_based_target_line(base_line_guid):
    divide_pts_list = []
    base_line = rs.coercecurve(base_line_guid)

    if base_line.PointAtStart.Z == 0 or base_line.PointAtEnd.Z == 0:
        divide_segments = 20

        if base_line.PointAtStart.Z == 0:
            gl_point = base_line.PointAtStart
            to_point = base_line.PointAtEnd
        else:
            gl_point = base_line.PointAtEnd
            to_point = base_line.PointAtStart

        vector = Vector3d(to_point - gl_point)
        vector.Unitize()

        vector = Vector3d.Multiply(vector, 2000)
        vector = Vector3d.Add(vector, Vector3d(gl_point))

        desired_target_line = Line(Point3d(gl_point), Point3d(vector))

    else:
        divide_segments = 30

        # TODO ここでのターゲット曲線の生成方法にバグあり
        vec1 = Vector3d(base_line.PointAtStart - base_line.PointAt(0.5))
        vec2 = Vector3d(base_line.PointAtEnd - base_line.PointAt(0.5))

        vec1.Unitize()
        vec2.Unitize()

        new_vec1 = Vector3d.Multiply(vec1, 1500)
        new_vec2 = Vector3d.Multiply(vec2, 1500)
        new_vec1 = Vector3d.Add(new_vec1, Vector3d(base_line.PointAt(0.5)))
        new_vec2 = Vector3d.Add(new_vec2, Vector3d(base_line.PointAt(0.5)))

        desired_target_line = Line(Point3d(new_vec1), Point3d(new_vec2))

    # draw line in doc
    #desired_target_line = scriptcontext.doc.Objects.AddLine(desired_target_line)
    desired_target_line_guid = scriptcontext.doc.Objects.AddLine(desired_target_line)

    # draw divide point in doc
    divide_pts = rs.DivideCurve(desired_target_line_guid, divide_segments, False, True)
    for pt in divide_pts:
        divide_pts_list.append(pt)
        
        #pt_guid = rs.AddPoint(pt)
        #divide_pts.append(pt_guid)

    # Delete guid
    rs.DeleteObject(base_line_guid)
    rs.DeleteObject(desired_target_line_guid)

    return desired_target_line, divide_pts


# main 
base_line_guid = rs.AddLine(x, y)
desired_target_line, divide_pts = generate_based_target_line(base_line_guid)
# ---------- end python_11 ----------
sync_7 = SyncObject(
    GM=ln,
    AlwaysIncludeTextureCoordinates=False,
    Clickable=False,
    DefaultCurveThicknessMillimeters=2.5,
    DefaultGlossPercent=0,
    DefaultMaterialColor=RGB(255, 255, 255),
    DefaultSpecularPercent=0,
    Grabbable=False,
    Interactive=False,
    Occlusion=False,
    Outline=False,
    hasSerializedData=True)
assignmat_6 = AssignMaterial(SynchronizedGeometry=sync_7, SynchronizedMaterial=syncmat_5)

pt = Point(item_5)
pt_2 = Point(item_4)
python_12 = GhPythonScript(playground_instance=split_2.ListA, pt1=pt, pt2=pt_2)  # -> connected_timber_ids, playground_instance; inputs pt1: Point3d, pt2: Point3d
# ---------- python_12: Python ----------
import rhinoscriptsyntax as rs
import Rhino 

connected_timber_ids = []

print playground_instance

for timber in playground_instance.timbers_in_structure:

    result1 = Rhino.Geometry.PolylineCurve.ClosestPoint(timber.center_line, pt1)
    result2 = Rhino.Geometry.PolylineCurve.ClosestPoint(timber.center_line, pt2)
    
    to_pt1 = timber.center_line.PointAt(result1[1])
    to_pt2 = timber.center_line.PointAt(result2[1])
    
    dis1 = Rhino.Geometry.Point3d.DistanceTo(pt1, to_pt1)
    dis2 = Rhino.Geometry.Point3d.DistanceTo(pt2, to_pt2)
    
    if 0 <= dis1 <= 5:
        connected_timber_ids.append(timber.id)
    
    if 0 <= dis2 <= 5:
        connected_timber_ids.append(timber.id)
    
    if len(connected_timber_ids) == 2:
        break

print connected_timber_ids
playground_instance = playground_instance
# ---------- end python_12 ----------
panel_24 = Panel(python_12.connected_timber_ids)
_03_fix_base_target_line = Button()

python_13 = GhPythonScript()  # -> out, a; disabled
# ---------- python_13: Python ----------
import rhinoscriptsyntax as rs

rs.Command("-_Undo")
# ---------- end python_13 ----------
panel_25 = Panel(python_13.out)  # disabled

panel_26 = Panel("余計な線分がBakeされて、削除されていない")
panel_27 = Panel("""データの保存の有無
処理をとめる→Buttonで一時解決
データのreset
Command+Z機能
Binary Fileを上書きする前にUndoしたい""")

number_slider_19 = Slider(20, range=1..20)
sync_8 = SyncObject(
    GM=python_11.desired_target_line,
    AlwaysIncludeTextureCoordinates=False,
    Clickable=False,
    DefaultCurveThicknessMillimeters=2.5,
    DefaultGlossPercent=0,
    DefaultMaterialColor=RGB(255, 255, 255),
    DefaultSpecularPercent=0,
    Grabbable=False,
    Interactive=False,
    Occlusion=False,
    Outline=False,
    hasSerializedData=True)
sph_3 = Sphere(Base=python_11.divide_pts, Radius=number_slider_19)
volume = Volume(Geometry=sph_3)  # -> Volume, Centroid

sync_9 = SyncObject(
    GM=sph_3,
    AlwaysIncludeTextureCoordinates=False,
    Clickable=True,
    DefaultCurveThicknessMillimeters=2.5,
    DefaultGlossPercent=0,
    DefaultMaterialColor=RGB(255, 255, 255),
    DefaultSpecularPercent=0,
    Grabbable=False,
    Interactive=False,
    Occlusion=False,
    Outline=False,
    hasSerializedData=True)

taps_2 = TrackTaps(Devices=flatten(devices), Geometry=flatten(sync_9), IncludeEmptyTaps=False, hasSerializedData=True, update_mode=2)  # -> Device, Index
panel_28 = Panel(taps_2.Index)
item_6 = ListItem(List=volume.Centroid, Index=panel_28, Wrap=True)
rec_5 = DataRecorder(panel_28, DataLimit=3, RecordData=True)
panel_29 = Panel(item_6)
split_4 = SplitList(List=rec_5, Index="1")  # -> ListA, flatten(ListB)

rec_6 = DataRecorder(item_6, DataLimit=2, RecordData=True)

panel_30 = Panel(rec_6)
item_7 = ListItem(List=panel_30, Index="1", Wrap=True)
item_8 = ListItem(List=panel_30, Index="0", Wrap=True)
ln_2 = Line(StartPoint=item_8, EndPoint=item_7)
sync_10 = SyncObject(
    GM=ln_2,
    AlwaysIncludeTextureCoordinates=False,
    Clickable=False,
    DefaultCurveThicknessMillimeters=2.5,
    DefaultGlossPercent=0,
    DefaultMaterialColor=RGB(255, 255, 255),
    DefaultSpecularPercent=0,
    Grabbable=False,
    Interactive=False,
    Occlusion=False,
    Outline=False,
    hasSerializedData=True)

# ---- group: reset color
panel_31 = Panel(split_4.ListA)
item_9 = ListItem(List=sync_9, Index=panel_31, Wrap=True)
rgb_4 = ColourRGB(Alpha=255, Red=255, Green=255, Blue=255)
syncmat_6 = SyncMaterial(Material=rgb_4, hasSerializedData=True)
assignmat_7 = AssignMaterial(SynchronizedGeometry=item_9, SynchronizedMaterial=syncmat_6)

# ---- group: Selecting
panel_32 = Panel(split_4.ListB)
rgb_5 = ColourRGB(Alpha=255, Red=0, Green=0, Blue=255)
item_10 = ListItem(List=sync_9, Index=panel_32, Wrap=True)
syncmat_7 = SyncMaterial(Material=rgb_5, hasSerializedData=True)
assignmat_8 = AssignMaterial(SynchronizedGeometry=item_10, SynchronizedMaterial=syncmat_7)

# ----
rgb_6 = ColourRGB(Alpha=255, Red=0, Green=0, Blue=255)
syncmat_8 = SyncMaterial(Material=rgb_6, hasSerializedData=True)
assignmat_9 = AssignMaterial(SynchronizedGeometry=sync_10, SynchronizedMaterial=syncmat_8)

file_2 = ReadFile(File="G:\マイドライブ\2020\04_Master\2006_Generation-algorithm\RhinoPython\main_gh.py", PerLineParse=False)
path_5 = FilePath("G:\マイドライブ\2020\04_Master\2006_Generation-algorithm\RhinoPython\binary_file\playground.binaryfile")
path_6 = FilePath("G:\マイドライブ\2020\04_Master\2006_Generation-algorithm\RhinoPython\section_list\section_list.csv")
python_14 = GhPythonScript(
    Code=file_2,
    Binary_file_path=path_5,
    Section_list_path=path_6,
    Playground_instance=python_12.playground_instance,
    Connected_timber_ids=panel_24,
    Target_line_guid=ln_2,
    Flag=_03_fix_base_target_line)  # -> Out, Next_flag, Playground_instance

rec_7 = DataRecorder(python_14.Out, DataLimit=1, RecordData=True)
panel_33 = Panel(rec_7)
